# Grasshopper definition 22-1215 [48-724] Scripting Final Submission_Compiled.gh (Grasshopper 1.0.7)
# plug-ins: Average Circulation Paths, Offset Circulation Paths, Display Assign

# ---- group: Screenshot!!!
list = ValueList({"Option1", "Option2", "Option3"}, selected="Option3")
value_list = ValueList({"Senario1", "Senario2", "Senario3"}, selected="Senario3")
panel = Panel("F:\0_Google Cloud Drive\1_Coordination\F22_[48-724] Final Project Coordination\22-1102 Base Rhino File\22-1203 Snapshots for GIF\Snapshots")
panel_2 = Panel("11")
panel_3 = Panel("8.5")
panel_4 = Panel("600")
snapshot = Button()
concat = Concatenate(FragmentA="21-1203", FragmentE="_", FragmentB=list, FragmentD="_", FragmentC=value_list)
W = Multiplication(A="17", B="300")
H = Multiplication(A="11", B="300")
panel_5 = Panel("False")
captureview = Ladybug_CaptureView(
    fileName=concat,
    folder=panel,
    viewNames=simplify(graft("Screenshot")),
    imageWidth=W,
    imageHeight=simplify(graft(H)),
    keepAspectR="True",
    transparBack=True,
    capture=snapshot)  # -> imagePath; plug-in component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

# ----
_4 = Panel("4")  # disabled
_6 = Panel("6")  # disabled
_8 = Panel("8")
_10 = Panel("10")
_12 = Panel("12")
_14 = Panel("14")
_16 = Panel("16")  # disabled
offset_distance_options = Number([_4, _6, _8, _10, _12, _14, _16])

building_footprint_radius_default_50ft = Slider(50, range=48..55)

# ---- group: Part1 - Define Building Footprint
multiplication = Multiplication(A="4", B=building_footprint_radius_default_50ft)
division = Division(A=multiplication, B=2)
xy = XYPlane(Origin=Point(0, 0, 0))
neg = Negative(Value=division)
Y = UnitY(Factor=neg)
move = Move(Geometry=xy, Motion=Y)  # -> Geometry, Transform
X = UnitX(Factor=neg)
move_2 = Move(Geometry=move.Geometry, Motion=X)  # -> Geometry, Transform
sqgrid = Square(Plane=move_2.Geometry, Size=multiplication, ExtentX=1, ExtentY=1)  # -> Cells, Points
building_footprint = Curve(flatten(sqgrid.Cells))

# ----
minimum_turn_radius_default_12ft = ValueList({"8", "10", "12"}, selected="12")
partition_wall_height = Slider(18, range=0..32)

# ---- group: Click to Shuffle Circulation Design
trigger = Trigger(Interval=-1000, TimerInterval=1000, Target=average_circulation_paths)

# ---- group: Click To Accept Design
generate = Button()
purge = Button()

# ---- group: Display Area Categorization
small = Panel("31")
medium = Panel("120")
extra_large = Panel("800")
extra_small = Panel("6")
large = Panel("320")

# ---- group: Click To Bake Display Layout
click = Button()

# ---- group: Part2 - Path Formation
average_circulation_paths = AverageCirculationPaths(
    Bldg_area=building_footprint,
    Bldg_area_r=building_footprint_radius_default_50ft,
    Num_path_shorten="22",
    Min_radius=minimum_turn_radius_default_12ft)  # -> Area_center, Path_avg, Paths_shorten, Path_avg_randdivs, Quadpath_center
area_center = Curve(average_circulation_paths.Area_center)
path_avg = Curve(average_circulation_paths.Path_avg)
paths_shorten = Curve(average_circulation_paths.Paths_shorten)
path_avg_randdivs = Point(simplify(average_circulation_paths.Path_avg_randdivs))
quadpath_center = Curve(average_circulation_paths.Quadpath_center)

# ---- group: Helper Function - Sort Division Pts Along Edge
alongcrv = SortAlongCurve(Points=path_avg_randdivs, Curve=path_avg)  # -> Points, Indices
crv_cp = CurveClosestPoint(Point=alongcrv.Points, Curve=path_avg)  # -> Point, flatten(Parameter), Distance
cull_i = CullIndex(List=crv_cp.Parameter, Indices=-1, Wrap=True)
shift = ShiftList(List=crv_cp.Parameter, Shift=1, Wrap=False)
dom = ConstructDomain(DomainStart=cull_i, DomainEnd=shift)
pathsubcrv = SubCurve(BaseCurve=path_avg, Domain=dom)

# ---- group: Part3 - Offset Circulation Paths
offset_circulation_path = OffsetCirculationPaths(
    Bldg_area=building_footprint,
    Area_center=area_center,
    MarshallingSignalParameter=path_avg,
    Path_sub_crvs=pathsubcrv,
    Quadpath_center=quadpath_center,
    Offset_dist_opts=offset_distance_options,
    Path_w_main="2",
    Path_avg_randdivs=path_avg_randdivs,
    Wall_thickness=".8",
    Path_extend="24")  # -> Bldg_area, Area_center, CrvPartition, Crv_normal_set1, Crv_normal_set2, Path_area_joined, Overall_display_area, Crv_split_enforce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
crv = Curve(simplify(flatten(offset_circulation_path.CrvPartition)))
crv_2 = Curve(offset_circulation_path.Area_center)
crv_3 = Curve(offset_circulation_path.Crv_normal_set1)
crv_4 = Curve(offset_circulation_path.Crv_normal_set2)
crv_5 = Curve(offset_circulation_path.WallPartition_2D_split)
crv_6 = Curve(offset_circulation_path.Area_center_wall_region)
crv_7 = Curve(offset_circulation_path.Bldg_area)
crv_8 = Curve(offset_circulation_path.Path_area_joined)
crv_9 = Curve(offset_circulation_path.Overall_display_area)
crv_10 = Curve(offset_circulation_path.Crv_split_enforce)
crv_11 = Curve(offset_circulation_path.Partition_wall_region)
crv_12 = Curve(offset_circulation_path.Bldg_area_wall_region)

# ---- group: Part4 - Display Areas
pipeline = GeometryPipeline(
    GroupByLayer=False,
    GroupByType=False,
    IncludeHidden=True,
    IncludeLocked=True,
    LayerFilter="*ExportLayer-Default",
    NameFilter="*",
    SublayerFiltering=True,
    TypeFilter=4)
crv_13 = Curve(pipeline)
generate_display_areas = DisplayAssign(Area_crv_list=crv_13, Tolerance="15", Xs=extra_small, Sm=small, Md=medium, Lg=large, Xl=extra_large)  # -> Cross, Dp_xsmall, Dp_small, Dp_medium, Dp_large, Dp_xlarge, Display_area_sum
baketo_layer_name = Panel("ExportLayer-Display")
crv_14 = Curve(generate_display_areas.Dp_small)
crv_15 = Curve(generate_display_areas.Cross)
crv_16 = Curve(generate_display_areas.Dp_xsmall)
crv_17 = Curve(generate_display_areas.Dp_medium)
crv_18 = Curve(generate_display_areas.Dp_large)
crv_19 = Curve(generate_display_areas.Dp_xlarge)
crv_20 = Curve(flatten([crv_16, crv_14, crv_17, crv_18, crv_19, crv_7, crv_8, crv_11, crv_6, crv_12, crv_15, generate_display_areas.Cross]))
python = GhPythonScript(G=crv_20, Layer=baketo_layer_name, Bake=click)  # -> a
# ---------- python: Python ----------
"""Provides a scripting component.
    Inputs:
        G: Geometry to bake
        L: Layer name for bake
        B: Bake Activate
    Output:
        a: The a output variable"""
 
__author__ = "ScottD"
__version__ = "2019.08.10"
 
import rhinoscriptsyntax as rs
import scriptcontext
import Rhino
 
 
if Bake:
 
    print(type(G)) #debug message to Python output
 
    #we obtain the reference in the Rhino doc
    doc_object = scriptcontext.doc.Objects.Find(G)
    print(type(doc_object))
 
    attributes = doc_object.Attributes
    print('the type of attributes is: ' + str(type(attributes)))     #debug message to Python output
 
    geometry = doc_object.Geometry
    print('the type of geometry is: ' + str(type(doc_object)))     #debug message to Python output
 
    #we change the scriptcontext
    scriptcontext.doc = Rhino.RhinoDoc.ActiveDoc
 
    #we add both the geometry and the attributes to the Rhino doc
    rhino_brep = scriptcontext.doc.Objects.Add(geometry, attributes)
    print('the Rhino doc ID is: ' + str(rhino_brep))     #debug message to Python output
 
    #we can for example change the layer in Rhino...
    if not rs.IsLayer(Layer):
        rs.AddLayer(Layer)
    rs.ObjectLayer(rhino_brep, Layer)
 
    #we put back the original Grasshopper document as default
    scriptcontext.doc = ghdoc
    a = G
# ---------- end python ----------

# ----
display_area_calc = ListItem(List=flatten(generate_display_areas.Display_area_sum), Index=0, Wrap=True)  # -> Item, Item1, Item2, Item3, Item4

# ---- group: Area Computing
panel_6 = Panel(display_area_calc.Item)
panel_7 = Panel(display_area_calc.Item3)
panel_8 = Panel(display_area_calc.Item1)
panel_9 = Panel(display_area_calc.Item2)
panel_10 = Panel(display_area_calc.Item4)

# ---- group: Helper Function - Split Operation
boundary = BoundarySurfaces(Edges=crv_9)  # -> simplify(graft(Surfaces))
crv_21 = Curve([crv_7, crv_2, crv, crv_3, crv_4, crv_8, crv_10, crv_5])
srfsplit = SurfaceSplit(Surface=boundary, Curves=flatten(crv_21))
edges = BrepEdges(Brep=srfsplit)  # -> Naked, Interior, NonManifold
join = JoinCurves(Curves=edges.Naked, Preserve=False)  # -> simplify(Curves)
baketo_layer_name_2 = Panel("ExportLayer-Default")
simplify = SimplifyCurve(Curve=flatten(join))  # -> Curve, Simplified
python_2 = GhPythonScript(G=simplify.Curve, Layer=baketo_layer_name_2, Bake=generate, Purge=purge)  # -> a
# ---------- python_2: Python ----------
"""Provides a scripting component.
    Inputs:
        G: Geometry to bake
        L: Layer name for bake
        B: Bake Activate
    Output:
        a: The a output variable"""
 
__author__ = "ScottD"
__version__ = "2019.08.10"
 
import rhinoscriptsyntax as rs
import scriptcontext
import Rhino
 
 
if Bake:
 
    print(type(G)) #debug message to Python output
 
    #we obtain the reference in the Rhino doc
    doc_object = scriptcontext.doc.Objects.Find(G)
    print(type(doc_object))
 
    attributes = doc_object.Attributes
    print('the type of attributes is: ' + str(type(attributes)))     #debug message to Python output
 
    geometry = doc_object.Geometry
    print('the type of geometry is: ' + str(type(doc_object)))     #debug message to Python output
 
    #we change the scriptcontext
    scriptcontext.doc = Rhino.RhinoDoc.ActiveDoc
 
    #we add both the geometry and the attributes to the Rhino doc
    rhino_brep = scriptcontext.doc.Objects.Add(geometry, attributes)
    print('the Rhino doc ID is: ' + str(rhino_brep))     #debug message to Python output
 
    #we can for example change the layer in Rhino...
    if not rs.IsLayer(Layer):
        rs.AddLayer(Layer)
    rs.ObjectLayer(rhino_brep, Layer)
 
    #we put back the original Grasshopper document as default
    scriptcontext.doc = ghdoc
    a = G
    
scriptcontext.doc = Rhino.RhinoDoc.ActiveDoc

if Purge == 1:
   if Layer: rs.PurgeLayer(Layer)

scriptcontext.doc = ghdoc
# ---------- end python_2 ----------

# ----
Z = UnitZ(Factor=partition_wall_height)
extr = Extrude(Base=[crv_6, crv_11, crv_12], Direction=Z)
cap = CapHoles(Brep=flatten(extr))
sunion = SolidUnion(Breps=flatten(cap))
edges_2 = BrepEdges(Brep=sunion)  # -> Naked, Interior, NonManifold
preview = CustomPreview(Geometry=flatten(edges_2.Interior), Material=ColourSwatch(SwatchColor=RGB(0, 0, 0)))
preview_2 = CustomPreview(Geometry=sunion, Material=ColourSwatch(SwatchColor=RGB(51, 51, 51)))

# ---- group: Area Shuffle Preview
offset = OffsetCurve(Curve=simplify.Curve, Distance="-1", Corners=1)
boundary_2 = BoundarySurfaces(Edges=offset)

# ----
boundary_3 = BoundarySurfaces(Edges=crv_8)
boundary_4 = BoundarySurfaces(Edges=crv_16)
boundary_5 = BoundarySurfaces(Edges=crv_14)
boundary_6 = BoundarySurfaces(Edges=crv_17)
boundary_7 = BoundarySurfaces(Edges=crv_18)
boundary_8 = BoundarySurfaces(Edges=crv_19)
preview_3 = CustomPreview(Geometry=flatten(crv_20), Material=ColourSwatch(SwatchColor=RGB(0, 0, 0)))
preview_4 = CustomPreview(Geometry=boundary_7, Material=ColourSwatch(SwatchColor=RGB(146, 132, 240)))
preview_5 = CustomPreview(Geometry=boundary_3, Material=ColourSwatch(SwatchColor=RGB(207, 192, 78)))
preview_6 = CustomPreview(Geometry=boundary_4, Material=ColourSwatch(SwatchColor=RGB(255, 74, 74)))
preview_7 = CustomPreview(Geometry=boundary_5, Material=ColourSwatch(SwatchColor=RGB(85, 150, 173)))
preview_8 = CustomPreview(Geometry=boundary_6, Material=ColourSwatch(SwatchColor=RGB(237, 146, 90)))
preview_9 = CustomPreview(Geometry=boundary_8, Material=ColourSwatch(SwatchColor=RGB(111, 166, 103)))
